# Grasshopper definition Caso1.gh (Grasshopper 1.0.4)
# plug-ins: Karamba, Metalicas

number_slider = Slider(6, range=0..6)
number_slider_2 = Slider(6, range=5..8)
number_slider_3 = Slider(4.2, range=3..4.5)
panel = Panel("Apoios")
pt = Point([<point referenced from the Rhino model> x6])
line = LineSDL(Start=pt, Direction=Vector(0, 0, 1), Length=number_slider_2)
series = Series(Start=0, Step=number_slider_3, Count=number_slider)
end = EndPoints(Curve=line)  # -> Start, End
Z = UnitZ(Factor=series)
move = Move(Geometry=graft(end.End), Motion=Z)  # -> Geometry, Transform
line_2 = LineSDL(Start=move.Geometry, Direction=Vector(0, 0, 1), Length=number_slider_3)  # -> flatten(Line)

crv = Curve(simplify([<curve referenced from the Rhino model> x4]))
panel_2 = Panel("VS700/engaste")
panel_3 = Panel("VS700/coluna")
panel_4 = Panel("VS400/engaste")
panel_5 = Panel("VS400")
panel_6 = Panel("VS700")
crv_2 = Curve([<curve referenced from the Rhino model> x5])
crv_3 = Curve([<curve referenced from the Rhino model> x4])
crv_4 = Curve([<curve referenced from the Rhino model> x5])
crv_5 = Curve([<curve referenced from the Rhino model> x30])
line_3 = Line([crv_2, crv_4, crv_3, crv_5, crv])
Z_2 = UnitZ(Factor=number_slider_2)
cluster = Cluster(C=crv_2, B=line_3)
cluster_2 = Cluster(C=crv_4, B=line_3)
cluster_3 = Cluster(C=crv, B=line_3)
cluster_4 = Cluster(C=crv_5, B=line_3)
cluster_5 = Cluster(C=crv_3, B=line_3)
series_2 = Series(Start=0, Step=number_slider_3, Count=expr("x+1", number_slider))
move_2 = Move(Geometry=cluster_2, Motion=Z_2)  # -> graft(Geometry), Transform
move_3 = Move(Geometry=cluster_5, Motion=Z_2)  # -> graft(Geometry), Transform
move_4 = Move(Geometry=cluster_4, Motion=Z_2)  # -> graft(Geometry), Transform
move_5 = Move(Geometry=cluster_3, Motion=Z_2)  # -> graft(Geometry), Transform
move_6 = Move(Geometry=cluster, Motion=Z_2)  # -> graft(Geometry), Transform
Z_3 = UnitZ(Factor=series_2)
move_7 = Move(Geometry=move_5.Geometry, Motion=Z_3)  # -> flatten(Geometry), Transform
move_8 = Move(Geometry=move_4.Geometry, Motion=Z_3)  # -> flatten(Geometry), Transform
move_9 = Move(Geometry=move_2.Geometry, Motion=Z_3)  # -> flatten(Geometry), Transform
move_10 = Move(Geometry=move_3.Geometry, Motion=Z_3)  # -> flatten(Geometry), Transform
move_11 = Move(Geometry=move_6.Geometry, Motion=Z_3)  # -> flatten(Geometry), Transform

pt_2 = Point([<point referenced from the Rhino model> x3])
line_4 = LineSDL(Start=pt_2, Direction=Vector(0, 0, 1), Length=Slider(6, range=5..8))
end_2 = EndPoints(Curve=line_4)  # -> Start, End
Z_4 = UnitZ(Factor=series_2)
move_12 = Move(Geometry=graft(end_2.End), Motion=Z_4)  # -> Geometry, Transform
supp = SupportKaramba(PosInd=flatten(move_12.Geometry), menu=[buttons(on, on, on, off, off, off)])
supp_2 = SupportKaramba(PosInd=pt, menu=[buttons(on, on, on, off, off, off)])

line_5 = Line([line, line_2])
end_3 = EndPoints(Curve=cluster_4)  # -> Start, End
galapagos = Galapagos(fitness=analyzethi, gene=number_slider_3)
ma = MassAddition(Input=series)  # -> Result, PartialResults
addition = Addition(A=number_slider_2, B=ma.Result)
Z_5 = UnitZ(Factor=addition)

cs = PerfisCS(HMáximo=65, BfMáximo=650)
vs = PerfisVS(HMáximo=2000, BfMáximo=650)
item = CherryPicker(cs, ListIndex=72)
vs_2 = PerfisVS(HMáximo=2000, BfMáximo=650)
item_2 = CherryPicker(vs, ListIndex=88)
item_3 = CherryPicker(vs_2, ListIndex=52)
panel_8 = Panel(item)
panel_9 = Panel(item_2)
crosecselect = CrossSectionSelectorKaramba(ElementsIdentifiers="CS500X207", CrossSections=item)  # -> CrossSection, Info
crosecselect_2 = CrossSectionSelectorKaramba(ElementsIdentifiers=["VS700", "VS400/engaste", "VS700/engaste", "VS700/coluna"], CrossSections=item_2)  # -> CrossSection, Info
panel_10 = Panel(item_3)
crosecselect_3 = CrossSectionSelectorKaramba(ElementsIdentifiers="VS400", CrossSections=item_3)  # -> CrossSection, Info

joint_agent = BeamJointAgentKaramba(
    AtElementIdentifiers="VS700",
    ToElementIdentifiers="CS500X207",
    Ct_kN_m=Vector(0, 0, 0),
    Cr_kNm_rad=Vector(0, 0, 0),
    menu=[buttons(off, off, off, off, on, off)])
joint_agent_2 = BeamJointAgentKaramba(
    AtElementIdentifiers="VS700/coluna",
    ToElementIdentifiers="CS500X207",
    Ct_kN_m=Vector(0, 0, 0),
    Cr_kNm_rad=Vector(0, 0, 0),
    menu=[buttons(off, off, off, off, on, off)])
joint_agent_3 = BeamJointAgentKaramba(
    AtElementIdentifiers="VS400",
    ToElementIdentifiers=["VS700", "VS700/engaste", "VS700/coluna"],
    Ct_kN_m=Vector(0, 0, 0),
    Cr_kNm_rad=Vector(0, 0, 0),
    menu=[buttons(off, off, off, off, on, off)])

linetobeam = LineToBeamKaramba(Line=move_11.Geometry, New=True, Remove=True, LimitDistance_m=0.005, BeamIdentifier="VS700")  # -> Points, Element, Info
linetobeam_2 = LineToBeamKaramba(Line=move_9.Geometry, New=True, Remove=True, LimitDistance_m=0.005, BeamIdentifier="VS700/engaste")  # -> Points, Element, Info
linetobeam_3 = LineToBeamKaramba(Line=move_10.Geometry, New=True, Remove=True, LimitDistance_m=0.005, BeamIdentifier="VS700/coluna")  # -> Points, Element, Info
linetobeam_4 = LineToBeamKaramba(Line=move_8.Geometry, New=True, Remove=True, LimitDistance_m=0.005, BeamIdentifier="VS400")  # -> Points, Element, Info
linetobeam_5 = LineToBeamKaramba(Line=move_7.Geometry, New=True, Remove=True, LimitDistance_m=0.005, BeamIdentifier="VS400/engaste")  # -> Points, Element, Info
linetobeam_6 = LineToBeamKaramba(Line=line_5, New=True, Remove=True, LimitDistance_m=0.005, BeamIdentifier="CS500X207")  # -> Points, Element, Info

matprops = MaterialPropertiesKaramba(
    YoungsModulus_kN_cm2=20000,
    ShearModulus_kN_cm2=8076,
    SpecificWeight_kN_m3=78.5,
    CoefficientOfThermalExpansion_1_C=1e-05,
    YieldStrength_kN_cm2=25,
    Name="S235")
number_slider_4 = Slider(0, range=0..40)
Y = UnitY(Factor=number_slider_4)
Z_6 = UnitZ(Factor=number_slider_4)
eccent_beam = EccentricityOnBeamKaramba(Beam=linetobeam_4.Element, LocalEccentricity_cm=Z_6)
rdpoints = RemoveDuplicatePointsKaramba(
    Point=[linetobeam.Points, linetobeam_2.Points, linetobeam_3.Points, linetobeam_4.Points, linetobeam_5.Points],
    LimitDistance=0.005)  # -> OutPoint, Info, Indexes
X = UnitX(Factor=1)
Y_2 = UnitY(Factor=1)
panel_12 = Panel(vs_2)
orientate = OrientateBeamKaramba(Beam=linetobeam_6.Element, ZOrientation=Y_2, Alpha_deg=0)
matselect = MaterialSelectionKaramba(menu=[dropdown(3), dropdown(6)])
panel_17 = Panel("0")

crv_6 = Curve(<curve referenced from the Rhino model>)
move_13 = Move(Geometry=crv_6, Motion=Z_2)  # -> Geometry, Transform
move_14 = Move(Geometry=move_13.Geometry, Motion=Z_3)  # -> Geometry, Transform
eval = Evaluate(F="0.613*((V0*S1*S2*S3)²)/1000", V0="40", S1="1", S2="1.01", S3="1")
boundary = BoundarySurfaces(Edges=move_14.Geometry)
Z_7 = UnitZ(Factor=expr("-x", "6.5"))
mesh_breps = MeshBreps(
    Brep=boundary,
    InclusionPoints=rdpoints.OutPoint,
    MeshResolution=1,
    EdgeRefinementFactor=0.67,
    PointReduction=False,
    SmoothingStepSize=0,
    SmoothingIterations=5)  # -> Mesh, Info
multiplication = Multiplication(A="1.4", B=Z_7)
item_4 = ListItem(List=[multiplication, Z_7], Index=Slider(1, range=0..1), Wrap=True)
loads = LoadsKaramba(Vector=expr("1.4*x", Vector(0, 0, -1)), LCase=0, mode="Gravity")
loads_2 = LoadsKaramba(
    Vector=item_4,
    Mesh=mesh_breps.Mesh,
    BeamIdentifiers="VS400",
    LCase=0,
    mode="Mesh Load",
    menu=[buttons(off, on, off), buttons(on, on)])

extr = Extrude(Base=crv_6, Direction=Z_5)
debrep = DeconstructBrep(Brep=extr)  # -> Faces, Edges, Vertices
item_5 = ListItem(List=debrep.Faces, Index=0, Wrap=True)  # -> Item, Item1, Item2, Item3
merge = Merge(Data1=item_5.Item1, Data2=item_5.Item3)
merge_2 = Merge(Data1=item_5.Item, Data2=item_5.Item2)
Z_8 = UnitZ(Factor=eval)
multiplication_2 = Multiplication(A=Z_8, B=-0.6)
multiplication_3 = Multiplication(A=Z_8, B=0.8)
mesh_breps_2 = MeshBreps(
    Brep=graft(merge),
    InclusionPoints=rdpoints.OutPoint,
    MeshResolution=1,
    EdgeRefinementFactor=0.67,
    PointReduction=False,
    SmoothingStepSize=0,
    SmoothingIterations=5)  # -> flatten(Mesh), Info
item_6 = ListItem(List=[multiplication_3, multiplication_2], Index=Slider(0, range=0..1), Wrap=True)  # -> Item, Item1
merge_3 = Merge(Data1=item_6.Item, Data2=item_6.Item1)

loads_3 = LoadsKaramba(
    Vector=merge_3,
    Mesh=mesh_breps_2.Mesh,
    BeamIdentifiers="VS400",
    LCase=0,
    mode="Mesh Load",
    menu=[buttons(on, off, off), buttons(off, on)])

panel_18 = Panel(loads_3)

assemble = AssembleModelKaramba(
    Elem=flatten([linetobeam_5.Element, linetobeam_2.Element, linetobeam.Element, linetobeam_3.Element, eccent_beam, orientate]),
    Support=[supp_2, supp],
    Load=flatten([loads, loads_2, loads_3]),
    CrossSection=flatten([crosecselect.CrossSection, crosecselect_2.CrossSection, crosecselect_3.CrossSection]),
    Material=matprops,
    Joint=[joint_agent, joint_agent_2, joint_agent_3],
    LimitDistance_m=0.005)  # -> Model, Info, Mass_kg, CenterOfGravity
analyzethi = AnalyzeThIKaramba(Model=assemble.Model)  # -> CalculatedModel, MaximumDisplacement_m, ResultingForceOfGravity_kN, ElasticEnergy_kNm

analyzethii = AnalyzeThIIKaramba(Model=assemble.Model, LoadCase=-1, RTolerance=1e-05, MaxIterations=100, NoTensionalNII=False)  # -> CalculatedModel, MaximumDisplacement_m, ResultingForceOfGravity_kN, ElasticEnergy_kNm
bmodes = BucklingModesKaramba(Model=analyzethii.CalculatedModel, FromIndex=1, NumberOfModes=1, MaximumNumberOfIterations=300, Epsilon=1e-07)  # -> ModelWithBucklingModesAsLoadCaseResults, BucklingLoadFactors

modelview = ModelViewKaramba(Model=analyzethii.CalculatedModel, LoadCaseFactorsForLinearSuperposition=1, IndexIncrementOfVisibleLoadcase=0)  # -> Model, DeformedMesh, DeformedAxes, DeformedModel
beamview = BeamViewKaramba(Model=modelview.Model)  # -> Model, MeshesOfRenderedBeams, DeformedBeamAxes, LegendColors, LegendTags
legend = Legend(Colour=beamview.LegendColors, Tags=beamview.LegendTags, LegendType=1)

b_forces = BeamForcesKaramba(AnalyzedModel=modelview.Model, LCase=-1, MaximumDistanceBetweenResults_m=-1, NumberOfResultsPerBeamElement=5)  # -> AnalyzedModel, NormalForce_kN, ShearForceVz_kN, ShearForceVy_kN, BendingMomentMt_kNm, BendingMomentMy_kNm, BendingMomentMz_kNm
sort = SortList(Keys=b_forces.NormalForce_kN)  # -> reverse(Keys), ValuesA
item_7 = ListItem(List=sort.Keys, Index=0, Wrap=True)  # -> flatten(Item)
vercomp = VerficaçãoCompressão(Model=modelview.Model, ElementID="CS500X207", MáximoOuTodos=True, Majoração=False)  # -> NormalResistente, EstadoLimiteÚltimo, EstadoLimiteDeServiço
sort_2 = SortList(Keys=item_7)  # -> reverse(Keys), ValuesA
panel_19 = Panel(vercomp.EstadoLimiteÚltimo)
panel_20 = Panel(vercomp.NormalResistente)
verflex = VerficaçãoFlexão(Model=modelview.Model, ElementID="VS700", MáximoOuTodos=True, Majoração=False, LarguraDeFlambagem=-1)  # -> MomentoResistente, CortanteResistente, MomentoMáximo, CortanteMaxima, EstadoLimiteÚltimo
panel_21 = Panel(verflex.MomentoResistente)
panel_22 = Panel(verflex.MomentoMáximo)
panel_23 = Panel(verflex.CortanteResistente)
panel_24 = Panel(verflex.CortanteMaxima)

# ==== cluster Cluster
C = ClusterInput()
B = ClusterInput()
ccx = CurveCurve(CurveA=graft(C), CurveB=B)  # -> flatten(Points), ParamsA, ParamsB
len = Length(Curve=C)  # -> simplify(graft(Length))
crv_cp = CurveClosestPoint(Point=ccx.Points, Curve=graft(C))  # -> Point, Parameter, Distance
multiplication = Multiplication(A=simplify(ccx.ParamsA), B=len)  # -> graft(Result)
smaller = SmallerThan(FirstNumber=crv_cp.Distance, SecondNumber=0.001)  # -> SmallerThan, OrEqualTo
cull = CullPattern(List=crv_cp.Parameter, CullPattern=smaller.SmallerThan)
trim = TrimTree(Tree=ccx.ParamsA, Depth=1)  # -> simplify(Tree)
shatter = Shatter(Curve=simplify(graft(C)), Parameters=cull)
end = EndPoints(Curve=shatter)  # -> Start, End
rdlines = RemoveDuplicateLinesKaramba(Line=flatten(shatter), LimitDistance=0.005)  # -> OutLine, Info, Indexes
L = ClusterOutput(rdlines.OutLine)
