# Grasshopper definition Caso2.gh (Grasshopper 1.0.4)
# plug-ins: Karamba

crv = Curve(<curve referenced from the Rhino model>)
number_slider = Slider(4, range=0..20)
boundary = BoundarySurfaces(Edges=crv)
genes = GenePool(Decimals=1, Maximum=3, Minimum=0.7, Value=[0.7, 2.3, 3, 2.3, 0.7])
sdivide = DivideSurface(Surface=boundary, UCount=number_slider, VCount=Slider(10, range=0..20))  # -> simplify(Points), Normals, Parameters
addition = Addition(A=number_slider, B=1)
Z = UnitZ(Factor=genes)
move = Move(Geometry=sdivide.Points, Motion=graft(Z))  # -> Geometry, Transform
srfgrid = SurfaceFromPoints(Points=flatten(move.Geometry), UCount=addition, Interpolate=True)

genes_2 = GenePool(Decimals=1, Maximum=4, Minimum=-4, Value=[1, 0.6, 2.3, -1.5])
genes_3 = GenePool(Decimals=1, Maximum=4, Minimum=-4, Value=[1.8, 3.1, 4, 2.5])
vec = VectorXYZ(XComponent=genes_3, YComponent=genes_2, ZComponent=0)  # -> Vector, Length
pi = Pi(Factor=2)
division = Division(A=pi, B=3)
Z_2 = UnitZ(Factor=-5)
pt = Point([<point referenced from the Rhino model> x4])
move_2 = Move(Geometry=pt, Motion=vec.Vector)  # -> Geometry, Transform
series = Series(Start=0, Step=division, Count=3)
move_3 = Move(Geometry=pt, Motion=Z_2)  # -> Geometry, Transform
rotate = Rotate(Geometry=graft(move_2.Geometry), Angle=series, Plane=graft(move_3.Geometry))  # -> Geometry, Transform
Z_3 = UnitZ(Factor=1)
project = ProjectPoint(Point=rotate.Geometry, Direction=Z_3, Geometry=srfgrid)  # -> Point, Index

number_slider_2 = Slider(7, range=5..10)
number_slider_3 = Slider(9, range=5..10)
sdivide_2 = DivideSurface(Surface=srfgrid, UCount=number_slider_3, VCount=number_slider_2)  # -> simplify(Points), Normals, Parameters
flip = FlipMatrix(Data=sdivide_2.Points)
intcrv = Interpolate(Vertices=sdivide_2.Points, Degree=3, Periodic=False, KnotStyle=1)  # -> flatten(Curve), Length, Domain
intcrv_2 = Interpolate(Vertices=flip, Degree=3, Periodic=False, KnotStyle=1)  # -> flatten(Curve), Length, Domain
ccx = CurveCurve(CurveA=graft(intcrv.Curve), CurveB=intcrv_2.Curve)  # -> Points, ParamsA, ParamsB
trim = TrimTree(Tree=ccx.Points, Depth=1)
crv_cp = CurveClosestPoint(Point=trim, Curve=intcrv_2.Curve)  # -> Point, Parameter, Distance
divide = DivideCurve(Curve=intcrv.Curve, Count=number_slider_2, Kinks=False)  # -> Points, Tangents, Parameters
flip_2 = FlipMatrix(Data=crv_cp.Parameter)
shatter = Shatter(Curve=graft(intcrv.Curve), Parameters=divide.Parameters)  # -> flatten(Segments)
shatter_2 = Shatter(Curve=graft(intcrv_2.Curve), Parameters=flip_2)  # -> flatten(Segments)
explode = Explode(Curve=shatter, Recursive=True)  # -> flatten(Segments), Vertices
divide_2 = DivideCurve(Curve=shatter_2, Count=10, Kinks=False)  # -> Points, Tangents, Parameters
pline = PolyLine(Vertices=divide_2.Points, Closed=False)
explode_2 = Explode(Curve=pline, Recursive=True)  # -> flatten(Segments), Vertices
rdlines = RemoveDuplicateLinesKaramba(Line=explode.Segments, LimitDistance=0.005)  # -> OutLine, Info, Indexes
rdlines_2 = RemoveDuplicateLinesKaramba(Line=explode_2.Segments, LimitDistance=0.005)  # -> OutLine, Info, Indexes

cp = ClosestPoint(Point=project.Point, Cloud=flatten(ccx.Points))  # -> ClosestPoint, CPIndex, Distance
ln = Line(StartPoint=graft(move_3.Geometry), EndPoint=cp.ClosestPoint)

number_slider_4 = Slider(10, range=0..30)
number_slider_5 = Slider(50, range=20..80)
number_slider_6 = Slider(22, range=10..50)
number_slider_7 = Slider(23, range=10..50)
cross_sections = CrossSectionsKaramba(
    ElementsIdentifiers="main",
    Height_cm=number_slider_5,
    UpperFlangeWidth_cm=number_slider_4,
    LowerFlangeWidth_cm=number_slider_4,
    mode="Trapezoid")
cross_sections_2 = CrossSectionsKaramba(
    ElementsIdentifiers="col",
    Height_cm=number_slider_6,
    UpperFlangeWidth_cm=number_slider_6,
    LowerFlangeWidth_cm=number_slider_6,
    mode="Trapezoid")
cross_sections_3 = CrossSectionsKaramba(
    ElementsIdentifiers="aux",
    Height_cm=number_slider_7,
    UpperFlangeWidth_cm=number_slider_4,
    LowerFlangeWidth_cm=number_slider_4,
    mode="Trapezoid")

linetobeam = LineToBeamKaramba(Line=flatten(ln), New=True, Remove=True, LimitDistance_m=0.005, BeamIdentifier="col")  # -> Points, Element, Info
linetobeam_2 = LineToBeamKaramba(Line=rdlines.OutLine, New=True, Remove=True, LimitDistance_m=0.005, BeamIdentifier="aux")  # -> Points, Element, Info
linetobeam_3 = LineToBeamKaramba(Line=rdlines_2.OutLine, New=True, Remove=True, LimitDistance_m=0.005, BeamIdentifier="main")  # -> Points, Element, Info

matselect = MaterialSelectionKaramba(menu=[dropdown(3), dropdown(6)])

joint_agent = BeamJointAgentKaramba(
    AtElementIdentifiers="col",
    ToElementIdentifiers=["main", "aux"],
    Ct_kN_m=Vector(0, 0, 0),
    Cr_kNm_rad=Vector(0, 0, 0),
    menu=[buttons(off, off, off, on, on, on)])
supp = SupportKaramba(PosInd=move_3.Geometry, menu=[buttons(on, on, on, off, off, off)])

galapagos = Galapagos(fitness=item_4, gene=[genes_3, genes_2])

loads = LoadsKaramba(Vector=Vector(0, 0, -1), LCase=0, mode="Gravity")
mesh_breps = MeshBreps(
    Brep=srfgrid,
    InclusionPoints=linetobeam_2.Points,
    MeshResolution="0.7",
    EdgeRefinementFactor=0.67,
    PointReduction=False,
    SmoothingStepSize=0,
    SmoothingIterations=5)  # -> Mesh, Info
Z_4 = UnitZ(Factor=-2)
loads_2 = LoadsKaramba(Vector=Z_4, Mesh=mesh_breps.Mesh, LCase=0, mode="Mesh Load", menu=[buttons(off, on, off), buttons(on, on)])

crv_2 = Curve(intcrv.Curve)
crv_3 = Curve(intcrv_2.Curve)
item = ListItem(List=intcrv_2.Curve, Index=0, Wrap=True)
subtraction = Subtraction(A=number_slider_5)
division_2 = Division(A=subtraction, B=200)
division_3 = Division(A=number_slider_7, B=-100)
pframes = PerpFrames(Curve=item, Count=number_slider_3, Align=True)  # -> Frames, Parameters
division_4 = Division(A=number_slider_5, B=-200)
addition_2 = Addition(A=division_3, B=division_2)
Z_5 = UnitZ(Factor=division_4)
Z_6 = UnitZ(Factor=addition_2)
deplane = DeconstructPlane(Plane=pframes.Frames)  # -> Origin, XAxis, YAxis, ZAxis
move_4 = Move(Geometry=crv_3, Motion=Z_5)  # -> Geometry, Transform
move_5 = Move(Geometry=crv_2, Motion=Z_6)  # -> Geometry, Transform
num = Number(number_slider_4)
division_5 = Division(A=num, B=100)
Z_7 = UnitZ(Factor=expr("x/100", number_slider_5))
item_2 = ListItem(List=deplane.XAxis, Index=0, Wrap=True)
devec = DeconstructVector(Vector=item_2)  # -> XComponent, YComponent, ZComponent
Z_8 = UnitZ(Factor=expr("1.1*x/100", number_slider_7))
ext = ExtendCurve(Curve=move_4.Geometry, Type=0, Start=division_5, End=division_5)
ext_2 = ExtendCurve(Curve=move_5.Geometry, Type=0, Start=division_5, End=division_5)
c_script = CSharpScript(x=devec.ZComponent)  # -> out, A; inputs x: Double
# ---------- c_script: C# ----------
    double result = 0;
    if (x < 0){result = -1;}
    if (x > 0) {result = 1;}
    A = result;
# ---------- end c_script ----------
move_6 = Move(Geometry=ext_2, Motion=Z_8)  # -> Geometry, Transform
Z_9 = UnitZ(Factor=c_script.A)
divide_3 = DivideCurve(Curve=move_6.Geometry, Count=number_slider_3, Kinks=False)  # -> Points, Tangents, Parameters
extr = Extrude(Base=ext, Direction=Z_7)
extr_2 = Extrude(Base=ext_2, Direction=Z_8)
item_3 = ListItem(List=divide_3.Points, Index=0, Wrap=True)  # -> flatten(Item)
orient = OrientDirection(Geometry=extr_2, PointA=item_3, DirectionA=Z_9, PointB=item_3, DirectionB=deplane.XAxis)  # -> Geometry, Transform
multiplication = Multiplication(A=deplane.ZAxis, B=number_slider_4)
num_2 = Number(number_slider_4)
Y = UnitY(Factor=expr("-x/200", num_2))
Y_2 = UnitY(Factor=expr("x/100", num_2))
division_6 = Division(A=multiplication, B=100)
division_7 = Division(A=multiplication, B=-200)
move_7 = Move(Geometry=extr, Motion=Y)  # -> Geometry, Transform
move_8 = Move(Geometry=orient.Geometry, Motion=division_7)  # -> Geometry, Transform
extr_3 = Extrude(Base=move_7.Geometry, Direction=Y_2)
extr_4 = Extrude(Base=move_8.Geometry, Direction=division_6)
sdiff = SolidDifference(BrepsA=extr_3, BrepsB=extr_4)
brep = Brep(sdiff)

assemble = AssembleModelKaramba(
    Elem=flatten([linetobeam_3.Element, linetobeam.Element, linetobeam_2.Element]),
    Support=supp,
    Load=flatten([loads_2, loads]),
    CrossSection=[cross_sections_3, cross_sections, cross_sections_2],
    Material=matselect,
    Joint=flatten(joint_agent),
    LimitDistance_m=0.005)  # -> Model, Info, Mass_kg, CenterOfGravity
analyzethii = AnalyzeThIIKaramba(Model=assemble.Model, LoadCase=-1, RTolerance=1e-07, MaxIterations=50, NoTensionalNII=False)  # -> CalculatedModel, MaximumDisplacement_m, ResultingForceOfGravity_kN, ElasticEnergy_kNm; disabled
analyzethi = AnalyzeThIKaramba(Model=assemble.Model)  # -> CalculatedModel, MaximumDisplacement_m, ResultingForceOfGravity_kN, ElasticEnergy_kNm
bmodes = BucklingModesKaramba(Model=analyzethii.CalculatedModel, FromIndex=1, NumberOfModes=1, MaximumNumberOfIterations=300, Epsilon=1e-07)  # -> ModelWithBucklingModesAsLoadCaseResults, BucklingLoadFactors; disabled
nvibes = NaturalVibrationsKaramba(Model=assemble.Model, FromIndex=1, NumberOfModes=1, MaximumNumberOfIterations=30, Epsilon=1e-05)  # -> ModelWithVibrationModesAsLoadCaseResults, NaturalFrequencies_Hz, ModalMass_kg, ParticipationFactorInGlobalXYAndZDirection; disabled
modelview = ModelViewKaramba(Model=analyzethi.CalculatedModel, LoadCaseFactorsForLinearSuperposition=1, IndexIncrementOfVisibleLoadcase=0)  # -> Model, DeformedMesh, DeformedAxes, DeformedModel
beamview = BeamViewKaramba(Model=modelview.Model)  # -> Model, MeshesOfRenderedBeams, DeformedBeamAxes, LegendColors, LegendTags
legend = Legend(Colour=beamview.LegendColors, Tags=beamview.LegendTags, LegendType=1)

utilization = UtilizationOfElementsKaramba(
    AnalyzedModel=modelview.Model,
    LoadCase=-1,
    NumberOfSamplePoints=3,
    ElasticDesign=True,
    GammaM0=1,
    GammaM1=1,
    WithDetails=False,
    mode="Beams")  # -> AnalyzedModel, Utilization, SigMax_kN_cm2, SigMin_kN_cm2, TauMax_kN_cm2, UtilN, UtilVy, UtilVz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
galapagos_2 = Galapagos(fitness=ma_3, gene=[genes_4, genes_6, genes_5])
sort = SortList(Keys=utilization.Utilization)  # -> Keys, ValuesA
ma = MassAddition()  # -> Result, PartialResults
rev = ReverseList(List=sort.Keys)
item_4 = ListItem(List=rev, Index=0, Wrap=True)
swatch = ColourSwatch(SwatchColor=RGB(204, 105, 0))
material = CreateMaterial(Diffuse=swatch, Specular=swatch, Emission=swatch, Transparency=0, Shine=0)

line = Line(ln)
division_8 = Division(A=number_slider_6, B=100)
ext_3 = ExtendCurve(Curve=line, Type=0, Start=expr("-x", Slider(1, range=0..1.5)), End=expr("-x", 0))
end = EndPoints(Curve=ext_3)  # -> Start, End
Z_10 = UnitZ(Factor=number_slider_5)
move_9 = Move(Geometry=end.End, Motion=expr("-0.005*x", Z_10))  # -> Geometry, Transform
rectangle = Rectangle(Plane=PlaneXY(0, 0, 0), XSize=division_8, YSize=division_8, Radius=0)  # -> Rectangle, Length
xy = XYPlane(Origin=end.Start)
ln_2 = Line(StartPoint=end.Start, EndPoint=move_9.Geometry)
curvepoint = PointOnCurve(ln_2, parameter=0.5)
crv_cp_2 = CurveClosestPoint(Point=curvepoint, Curve=ln_2)  # -> Point, Parameter, Distance
pframe = PerpFrame(Curve=ln_2, Parameter=crv_cp_2.Parameter)
ext_4 = ExtendCurve(Curve=ln_2, Type=0, Start=expr("-x", 0), End="0.1")
deplane_2 = DeconstructPlane(Plane=pframe)  # -> Origin, XAxis, YAxis, ZAxis
slx = SurfaceLine(Surface=graft(extr), Line=flatten(ext_4), LimitToFirst=False)  # -> Curves, simplify(Points), UVPoints, Normal
path_mapper = PathMapper(slx.Points, source="{A;B}(i)", target="{A;i}(B)")
trim_2 = TrimTree(Tree=slx.Points, Depth=1)
null = NullItem(Item=path_mapper)  # -> NullFlags, InvalidFlags, Description
not = GateNot(A=null.NullFlags)
cull = CullPattern(List=path_mapper, CullPattern=not)
crv_cp_3 = CurveClosestPoint(Point=cull, Curve=graft(ext))  # -> Point, Parameter, Distance
frame = CurveFrame(Curve=graft(ext), Parameter=crv_cp_3.Parameter)
deplane_3 = DeconstructPlane(Plane=frame)  # -> Origin, XAxis, YAxis, ZAxis
pl = ConstructPlane(Origin=deplane_3.Origin, XAxis=deplane_3.XAxis, YAxis=deplane_3.ZAxis)  # -> flatten(Plane)

cluster = Cluster(C=rectangle.Rectangle)

genes_4 = GenePool(Decimals=4, Maximum=0.5, Minimum=-0.5, Value=[-0.0254, -0.0581, -0.0213, 0.0214])
genes_5 = GenePool(Decimals=4, Maximum=0.5, Minimum=-0.5, Value=[-0.0002, 0.0029, 0.0091, 0.0081])
genes_6 = GenePool(Decimals=4, Maximum=0.5, Minimum=-0.5, Value=[0.0128, 0.075, 0.003, -0.0145])
pl_2 = PlaneNormal(Origin=end.Start, ZAxis=deplane_2.ZAxis)
merge = Merge(Data1=graft(genes_4), Data2=graft(genes_6), Data3=graft(genes_5))

orient_2 = OrientDirection(Geometry=rectangle.Rectangle, PointA=cluster, DirectionA=Vector(0, 0, 1), PointB=xy, DirectionB=deplane_2.ZAxis)  # -> simplify(Geometry), Transform

rotate_2 = Rotate(Geometry=orient_2.Geometry, Angle=merge, Plane=pl_2)  # -> Geometry, Transform

extrcrv = ExtrudeAlong(Base=simplify(rotate_2.Geometry), Curve=simplify(ext_4))  # -> simplify(Extrusion)
flatten = FlattenTree(Tree=extrcrv, Path="{0}")
graft = GraftTree(Tree=flatten, IncludeEmptyLists=True, IncludeNullItems=True)  # -> simplify(Tree)
pull = PullPoint(Point=flatten(deplane_3.Origin), Geometry=graft, ClosestOnly=True)  # -> ClosestPoint, Distance
smaller = SmallerThan(FirstNumber=pull.Distance, SecondNumber="0.2")  # -> SmallerThan, OrEqualTo
cull_2 = CullPattern(List=flatten(pl), CullPattern=smaller.SmallerThan)
sec = BrepPlane(Brep=graft, Plane=cull_2)  # -> Curves, Points
boundary_2 = BoundarySurfaces(Edges=sec.Curves)
split = SplitBrep(Brep=graft, Cutter=boundary_2)
area = Area(Geometry=split)  # -> simplify(Area), Centroid
larger = LargerThan(FirstNumber=area.Area, SecondNumber="0.2")  # -> LargerThan, OrEqualTo
cull_3 = CullPattern(List=split, CullPattern=larger.LargerThan)

deplane_4 = DeconstructPlane(Plane=pl_2)  # -> Origin, XAxis, YAxis, ZAxis
project_2 = Project(Geometry=rotate_2.Geometry, Plane=deplane_4.Origin)  # -> Geometry, Transform
explode_3 = Explode(Curve=project_2.Geometry, Recursive=True)  # -> Segments, Vertices
item_5 = ListItem(List=explode_3.Vertices, Index=0, Wrap=True)  # -> Item, Item1
explode_4 = Explode(Curve=rotate_2.Geometry, Recursive=True)  # -> Segments, Vertices
item_6 = ListItem(List=explode_4.Segments, Index=0, Wrap=True)  # -> Item, Item1, Item2
vec2pt = Vector2Pt(PointA=item_5.Item, PointB=item_5.Item1, Unitize=True)  # -> Vector, Length
curvepoint_2 = PointOnCurve(item_6.Item, parameter=0.5)
curvepoint_3 = PointOnCurve(item_6.Item2, parameter=0.5)
devec_2 = DeconstructVector(Vector=vec2pt.Vector)  # -> flatten(XComponent), YComponent, ZComponent
end_2 = EndPoints(Curve=ln)  # -> Start, End
ln_3 = Line(StartPoint=curvepoint_2, EndPoint=curvepoint_3)  # -> simplify(Line)
ma_2 = MassAddition(Input=devec_2.XComponent)  # -> Result, PartialResults
rdpoints = RemoveDuplicatePointsKaramba(Point=end_2.Start, LimitDistance=0.005)  # -> OutPoint, Info, Indexes
trim_3 = TrimTree(Tree=ln_3, Depth=1)  # -> simplify(Tree)
pframe_2 = PerpFrame(Curve=ln_3, Parameter=Slider(0, range=0..100))
curvepoint_4 = PointOnCurve(trim_3, parameter=0.5)
project_3 = Project(Geometry=trim_3, Plane=rdpoints.OutPoint)  # -> Geometry, Transform
deplane_5 = DeconstructPlane(Plane=pframe_2)  # -> Origin, XAxis, YAxis, ZAxis
rectangle_2 = Rectangle(Plane=rdpoints.OutPoint, XSize="-0.7 to 0.7", YSize="-0.7 to 0.7", Radius=0)  # -> Rectangle, Length
Z_11 = UnitZ(Factor=Slider(0.32, range=0..2))
ln_4 = Line(StartPoint=curvepoint_4, EndPoint=rdpoints.OutPoint)
vec2pt_2 = Vector2Pt(PointA=curvepoint_4, PointB=rdpoints.OutPoint, Unitize=False)  # -> Vector, Length
extrcrv_2 = ExtrudeAlong(Base=trim_3, Curve=ln_4)
boundary_3 = BoundarySurfaces(Edges=rectangle_2.Rectangle)
move_10 = Move(Geometry=boundary_3, Motion=Z_11)  # -> Geometry, Transform
bbx = BrepBrep(BrepA=move_10.Geometry, BrepB=extrcrv_2)  # -> Curves, Points
number_slider_8 = Slider(0.2, range=0..0.4)
trim_4 = TrimTree(Tree=bbx.Curves, Depth=1)  # -> simplify(Tree)
ext_5 = ExtendCurve(Curve=trim_4, Type=0, Start=number_slider_8, End=number_slider_8)  # -> graft(Curve)
trim_5 = TrimTree(Tree=ext_5, Depth=1)  # -> simplify(Tree)
merge_2 = Merge(Data1=trim_3, Data2=trim_5)
flip_3 = FlipMatrix(Data=merge_2)
fitloft = FitLoft(Curves=simplify([ext_5, ln_3]), CountU=15, DegreeU=5, DegreeV=5)

flatten_2 = FlattenTree(Tree=sec.Curves, Path="{0}")
project_4 = Project(Geometry=flatten_2, Plane=PlaneXY(0, 0, 0))  # -> Geometry, Transform
explode_5 = Explode(Curve=project_4.Geometry, Recursive=True)  # -> Segments, Vertices
item_7 = ListItem(List=explode_5.Vertices, Index=0, Wrap=True)  # -> Item, Item1
ln_5 = Line(StartPoint=item_7.Item, EndPoint=item_7.Item1)
vec2pt_3 = Vector2Pt(PointA=item_7.Item, PointB=item_7.Item1, Unitize=True)  # -> Vector, Length
devec_3 = DeconstructVector(Vector=vec2pt_3.Vector)  # -> XComponent, YComponent, ZComponent
abs = Absolute(Value=devec_3.XComponent)
ma_3 = MassAddition(Input=flatten(abs))  # -> Result, PartialResults

preview = CustomPreview(Geometry=flatten([fitloft, boundary_3, move_10.Geometry]), Material=ColourSwatch(SwatchColor=RGB(133, 133, 133)))
preview_2 = CustomPreview(Geometry=flatten([cull_3, brep, extr_4]), Material=material)

# ==== cluster Cluster
C = ClusterInput()
explode = Explode(Curve=C, Recursive=True)  # -> Segments, Vertices
join = JoinCurves(Curves=explode.Segments, Preserve=False)
pcen = PolygonCenter(Polyline=join)  # -> CenterV, CenterE, CenterA
ce = ClusterOutput(pcen.CenterE)
